# Grasshopper definition Components bookWorm.gh (Grasshopper 1.0.7)
# plug-ins: Bookworm

toggle = BooleanToggle(True)
toggle_2 = BooleanToggle(True)
toggle_3 = BooleanToggle(True)
swatch = ColourSwatch(SwatchColor=RGB(196, 0, 255))
concellborder = ConstructCellBorder(BorderStyle="2", Color=ColourSwatch(SwatchColor=RGB(255, 242, 0)))
concellborder_2 = ConstructCellBorder(BorderStyle="5", Color=ColourSwatch(SwatchColor=RGB(255, 149, 0)))
connumberformat = ConstructNumberFormat(NumberFormatType="5")
connumberformat_2 = ConstructNumberFormat()
contextformat = ConstructTextFormat(
    ForegroundColor=swatch,
    FontFamily="Verdana",
    FontSize=Slider(15, range=0..100),
    Bold=toggle_2,
    Italic=Toggle(False),
    Strikethrought=toggle_2,
    Underline=toggle_2)
panel = Panel(ColourSwatch(SwatchColor=RGB(242, 205, 94)))
contextrotation = ConstructTextRotation(Angle=Slider(60, range=-90..90))
panel_2 = Panel(swatch)
conpadding = ConstructPadding(Top="50", Bottom="20", Left=0, Right=0)
concellborders = ConstructCellBorders(BorderTop=concellborder, BorderBottom=concellborder_2, BorderLeft=concellborder_2, BorderRight=concellborder)
panel_3 = Panel(concellborders)
swatch_2 = ColourSwatch(SwatchColor=RGB(146, 189, 4))
panel_4 = Panel(swatch_2)
panel_5 = Panel(connumberformat)
panel_6 = Panel(contextformat)
panel_7 = Panel(contextrotation)
panel_8 = Panel(conpadding)

number_slider = Slider(2, range=0..10)
number_slider_2 = Slider(0, range=0..10)
number_slider_3 = Slider(3, range=0..10)
number_slider_4 = Slider(1, range=0..10)

number_slider_5 = Slider(500, range=0..1000)
panel_9 = Panel("""Количество комнат
Евро
Студия""")
conextendedvalue = ConstructExtendedValue(Value=panel_9)
panel_10 = Panel("136sKKVnzYGOcDbLzDCTKq6zVEHlm_2nUyYPIjH6f-F4")
concellformat = ConstructCellFormat(
    NumberFormat=connumberformat_2,
    BackgroundColor=swatch_2,
    Borders=concellborders,
    Padding=conpadding,
    TextFormat=contextformat,
    TextRotation=contextrotation)

# ---- group: Delete sheet
delsheet = DeleteSheet(SpreadsheetURL="1A4-OZONXYfRZbBfHRNpN6nU8IgeaBQi29x4bGgja-Aw", SheetName="Лист10", Run=Toggle(False))

# ---- group: Read cell
panel_11 = Panel("1A4-OZONXYfRZbBfHRNpN6nU8IgeaBQi29x4bGgja-Aw")
panel_12 = Panel("ns gbkjh")
toggle_4 = BooleanToggle(True)
panel_13 = Panel("b:c")
readcell = ReadCell(
    SpreadsheetURL=panel_11,
    SheetName=panel_12,
    CellRange=panel_13,
    DuplicateMerged=False,
    SameLength=False,
    Read=Toggle(True))

# ---- group: Read cell value
readcellvalue = ReadCellValue(SpreadsheetURL=panel_11, SheetName=panel_12, CellRange=panel_13, Read=Toggle(True), SameLength=Toggle(False))

# ----
toggle_5 = BooleanToggle(True)
concell = ConstructCell(UserEnteredValue=conextendedvalue, CellFormat=concellformat)
panel_14 = Panel(concellformat)
readcell_2 = ReadCell(
    SpreadsheetURL=panel_10,
    SheetName="Квартирография_1",
    CellRange="A1:B2",
    DuplicateMerged=False,
    SameLength=False,
    Read=False)  # disabled
writecell = WriteCells(SpreadsheetURL=panel_10, SheetName="Квартирография_1", CellRange="J1:J4", Cells=concell, Run=Button())
merge = Merge(Data1=concell, Data2=concell)
decell = DeconstructCell(Cell=readcell_2)  # -> FormattedValue, UserEnteredValue, CellFormat
panel_15 = Panel(readcellvalue)
concell_2 = ConstructCell(UserEnteredValue=decell.UserEnteredValue, CellFormat=decell.CellFormat)  # -> flatten(Cell)
panel_16 = Panel("1A4-OZONXYfRZbBfHRNpN6nU8IgeaBQi29x4bGgja-Aw")
decell_2 = DeconstructCell(Cell=readcell)  # -> FormattedValue, UserEnteredValue, CellFormat
panel_17 = Panel("brandnew")
panel_18 = Panel(readcell)
panel_19 = Panel("A1:B2")
cull_i = CullIndex(List=concell_2, Indices="3", Wrap=True)
concell_3 = ConstructCell(UserEnteredValue=decell_2.UserEnteredValue, CellFormat=decell_2.CellFormat)  # -> flatten(Cell)
nickname = MergeCells(SpreadsheetURL=panel_16, SheetName="ns gbkjh", CellRange="G1:h2", MergeType="2", Run=Toggle(False))
item = ListItem(List=cull_i, Index=0, Wrap=True)
panel_20 = Panel(decell_2.CellFormat)
panel_21 = Panel(decell_2.FormattedValue)
panel_22 = Panel(decell_2.UserEnteredValue)
merge_2 = Merge(Data1=cull_i, Data2=item)  # -> flatten(Result)
panel_23 = Panel(merge_2)
nickname_2 = UnmergeCells(SpreadsheetURL=panel_16, SheetName="ns gbkjh", CellRange="G1:h2", Run=Toggle(False))
writecell_2 = WriteCells(SpreadsheetURL=panel_16, SheetName="ns gbkjh", CellRange="18:19", Cells=merge, Run=Toggle(False))
item_2 = ListItem(List=merge_2, Index="2", Wrap=True)
