# Grasshopper definition bookWormTest.gh (Grasshopper 1.0.7)
# plug-ins: Bookworm, Wombat

toggle = BooleanToggle(True)
таблица_жкх = Panel("1hmfjhkAOD-10Y10xjsALjVix-NEjcNN9qug2n2QNazE")

# ---- group: Column
panel = Panel("B:B")

# ---- group: Range
panel_2 = Panel("A1:C4")

# ----
panel_3 = Panel("""Лист1
Лист2
Лист лист""")
panel_4 = Panel("SHB-2021")
тестоваая_ноунейм_таблица = Panel("1jbaOPPZVP5nyDE-QCvQtBNV5eBMV6PDvZfyrDdtQ9xg")
panel_5 = Panel("Лист2")

# ---- group: OLD
readcell = ReadCellRange(SpreadsheetId=тестоваая_ноунейм_таблица, SheetName=panel_3, CellRange=panel_2, Read=toggle, SameLength=False)

# ---- group: Read cells
nickname = ReadCells(SpreadsheetId=тестоваая_ноунейм_таблица, SheetName=panel_3, CellRange=panel_2, Read=toggle, SameLength=False)

# ----
panel_6 = Panel(readcell)

# ---- group: requested cells
panel_7 = Panel(nickname)

# ---- group: null test
null = NullObject()
merge = Merge(Data1=nickname, Data2=null)

# ----
decell = DeconstructCell(Cell=nickname)  # -> FormattedValue, UserEnteredValue, CellFormat

# ---- group: cell format
panel_8 = Panel(decell.CellFormat)

# ----
panel_9 = Panel(decell.FormattedValue)

# ---- group: user value
panel_10 = Panel(decell.UserEnteredValue)

# ----
concell = ConstructCell(UserEnteredValue=decell.UserEnteredValue, CellFormat=decell.CellFormat)

# ---- group: new cells
panel_11 = Panel(concell)

# ----
decell_2 = DeconstructCell(Cell=concell)  # -> FormattedValue, UserEnteredValue, CellFormat
nickname_2 = UpdateCells(Cells=concell, Range="*", Fields="*", Run=Toggle(False))
panel_12 = Panel(decell_2.UserEnteredValue)
panel_13 = Panel(decell_2.CellFormat)
panel_14 = Panel(decell_2.FormattedValue)
