# Grasshopper definition read_test_01.gh (Grasshopper 1.0.7)
# plug-ins: GoogleDocs

readcell = ReadCellRange(
    SpreadsheetId="1O5K70b2fVHKrf0aMlHnd3J1Zos-jS96cUqy6KKDs6Ug",
    SheetName="Layers",
    CellRange="A:XX",
    Read=Toggle(True),
    SameLength=Toggle(True))
panel = Panel(readcell)
