# Grasshopper definition read_test_02.gh (Grasshopper 1.0.7)
# plug-ins: Bookworm

readcell = ReadCellRange(
    SpreadsheetId="189ivxpQlX0liyjyUpZQuqZTJNz12dlLsAD8eIfFqsVE",
    SheetName="Лист1",
    CellRange="A1:A2",
    Read=Toggle(True),
    SameLength=False)
