# Grasshopper definition write_test_01.gh (Grasshopper 1.0.7)
# plug-ins: Bookworm

panel = Panel("""Oh my God!
It Works!""")
writecell = WriteCellRange(
    SpreadsheetId="1ASVkbiUlaTrZFx4he2xsmvZdjeuerDXULi5NwlzfFBk",
    SheetName="sheet1",
    CellRange="C10",
    Values=panel,
    Append=Toggle(True),
    Write=Toggle(False))
